% Simulink design studies scenariotests.mldatx for model control_simu

study "DesignStudy": 3 simulations
  combinatorial set (3 points):
    "Block Parameter_1": BlockParameter(BlockPath=control_simu/Signal Editor, Name=ActiveScenario), values Label=Scenario1, Label=Scenario2, Label=Step (3 points)